# Grasshopper definition geometry.gh (Grasshopper 1.0.7)
# plug-ins: Kangaroo2 Components

crv = Curve(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)
neg = Negative(Value=Slider(0.15, range=0..1))
ext = ExtendCurve(Curve=crv, Type=0, Start=neg, End=neg)
pt = ConstructPoint(XCoordinate=0, YCoordinate=0, ZCoordinate=0)
pipe = Pipe(Curve=ext, Radius=Slider(0.231, range=0..1), Caps=0)
xy = XYPlane(Origin=pt)
mesh = MeshBrep(
    Brep=pipe,
    Settings={GridMaxCount=0, GridMinCount=16, JaggedSeams=False, MaxEdgeLength=0, MinEdgeLength=0.0001, MinTolerance=0, Refine=True, RefineAngle=0, RelativeTolerance=0.65, SimplePlanes=True, Tolerance=0})
msplit = MeshSplitPlane(Mesh=mesh, Plane=xy)  # -> Above, Below
mesh_2 = Mesh(msplit.Above)
triremesh = TriRemesh(Geometry=mesh_2, Length=Slider(0.04, range=0..1), Iterations=25)  # -> Triangulation, Dual, Creases
