# Grasshopper definition geometry_generation.gh (Grasshopper 1.0.7)
# plug-ins: Kangaroo2 Components

rectangle = Rectangle(Plane=PlaneXY(0, 0, 0), XSize=Domain(-1, 1), YSize=Domain(-1, 1), Radius=0)  # -> Rectangle, Length
disc = Discontinuity(Curve=rectangle.Rectangle, Level=1)  # -> Points, Parameters
item = ListItem(List=disc.Points, Index=0, Wrap=True)  # -> Item, Item1, Item2, Item3
Z = UnitZ(Factor=Slider(1.7, range=0..2))
move = Move(Geometry=item.Item, Motion=Z)  # -> Geometry, Transform
move_2 = Move(Geometry=item.Item2, Motion=Z)  # -> Geometry, Transform
ln = Line(StartPoint=move.Geometry, EndPoint=item.Item1)
ln_2 = Line(StartPoint=item.Item3, EndPoint=move_2.Geometry)
loft = Loft(Curves=[ln, ln_2], Options={Adjust=False, Closed=False, LoftEnds=0, LoftSimp=0, LoftType=0, Rebuild=10, Refit=0.01})
mesh = MeshBrep(
    Brep=loft,
    Settings={GridMaxCount=0, GridMinCount=16, JaggedSeams=False, MaxEdgeLength=0, MinEdgeLength=0.0001, MinTolerance=0, Refine=True, RefineAngle=0, RelativeTolerance=0.65, SimplePlanes=True, Tolerance=0})
triremesh = TriRemesh(Geometry=loft, Length=Slider(0.055, range=0..1), Iterations=25)  # -> Triangulation, Dual, Creases
