# Grasshopper definition vizualization&debugging.gh (Grasshopper 1.0.7)

# ---- group: Path and folder name for data
folder = Panel("../data/schwarz/")
python = GhPythonScript()  # -> path
# ---------- python: Python ----------
__author__ = "ioanna"

import rhinoscriptsyntax as rs

import sys
import os

ghComp = ghenv.Component
ghDoc = ghComp.OnPingDocument()

# the full path of the gh file
path = ghDoc.FilePath
# the current directory 
path = os.path.abspath(os.path.join(path, ".."))

print path
# ---------- end python ----------

# ----
# Inputs
button = Button()
load_unwelded_mesh = GhPythonScript(recompute=button, path=python, folder=folder, filename="mesh.obj")  # -> out, mesh
# ---------- load_unwelded_mesh: Python ----------
__author__ = "ioanna"

import os
import Rhino.Geometry as rg
import rhinoscriptsyntax as rs


vertices = []
faces = []

for line in open(os.path.join(path, folder, filename), "r"):
    if line.startswith('#'): 
        continue
    values = line.split()
    if not values: 
        continue
        
    if values[0] == 'v':
        v = map(float, values[1:4])
        vertices.append(v)
    elif values[0] == 'f':
        face = []
        for v in values[1:]:
            w = v.split('/')
            face.append(int(w[0]))
        faces.append(face)
        
print('Vertices : ', len(vertices))    
print('Faces : ', len(faces))


mesh = rg.Mesh()

for v in vertices:
    mesh.Vertices.Add(v[0], v[1], v[2]);
for i, f in enumerate(faces):
    mesh.Faces.AddFace(f[0]-1, f[1]-1, f[2]-1);
# ---------- end load_unwelded_mesh ----------
scale_factor = GhPythonScript(recompute=Button(), path=python, folder=folder, filename="scale_factor.txt")  # -> out, s
# ---------- scale_factor: Python ----------
__author__ = "ioanna"

import rhinoscriptsyntax as rs
import os
import re
import Rhino.Geometry as rg

f_lines = open(os.path.join(path, folder, filename), "r").readlines()

for line in f_lines:
    s = line
# ---------- end scale_factor ----------

panel = Panel(load_unwelded_mesh.out)
scale_factor_2 = Data(scale_factor.s)
mesh = Mesh(load_unwelded_mesh.mesh)
input_mesh = Mesh(mesh)
scale = Scale(Geometry=input_mesh, Center=Point(0, 0, 0), Factor=scale_factor_2)  # -> Geometry, Transform

demesh = DeconstructMesh(Mesh=input_mesh)  # -> Vertices, Faces, Colours, Normals
conmesh = ConstructMesh(Vertices=demesh.Vertices, Faces=demesh.Faces)
medges = MeshEdges(Mesh=input_mesh)  # -> NakedEdges, InteriorEdges, NonManifoldEdges
curve_display = CSharpScript(
    Curve=[medges.NakedEdges, medges.InteriorEdges],
    Width=Slider(0.8, range=0..10),
    Colour=ColourSwatch(SwatchColor=RGB(113, 138, 227)))  # inputs Curve: Curve, Width: Int32, Colour: Color, Dash: String
# ---------- curve_display: C# ----------
    if (Curve == null) return;
    if (Width <= 0) return;

    double[] pattern = ParseDashPattern(Dash);
    IEnumerable<Curve> segments = ApplyDashPattern(Curve, pattern);

    _clip = BoundingBox.Union(_clip, Curve.GetBoundingBox(false));
    foreach (Curve segment in segments)
    {
      _curves.Add(segment);
      _colors.Add(Colour);
      _widths.Add(Width);
    }
# ---------- curve_display: C# additional code ----------
  /// <summary>
  /// Parse a dash pattern.
  /// </summary>
  /// <param name="pattern">Pattern to parse.</param>
  /// <returns>Array of dashes and gaps.</returns>
  private double[] ParseDashPattern(string pattern)
  {
    if (string.IsNullOrWhiteSpace(pattern))
      return null;

    string[] fragments = pattern.Split(new char[] {' '});
    if (fragments == null || fragments.Length == 0)
      return null;

    double[] values = new double[fragments.Length];
    for (int i = 0; i < fragments.Length; i++)
    {
      double v;
      if (!double.TryParse(fragments[i], out v))
        throw new Exception(fragments[i] + " is a not a valid number.");

      if (v <= 0.0)
        throw new Exception("Dashes or gaps must have a strictly positive length.");

      values[i] = v;
    }

    return values;
  }
  /// <summary>
  /// Apply a dash+gap pattern to a curve.
  /// </summary>
  private IEnumerable<Curve> ApplyDashPattern(Curve curve, double[] pattern)
  {
    if (pattern == null || pattern.Length == 0)
      return new Curve[] { curve };

    double curveLength = curve.GetLength();
    List<Curve> dashes = new List<Curve>();

    double offset0 = 0.0;
    int index = 0;
    while(true)
    {
      // Get the current dash length.
      double dashLength = pattern[index++];
      if (index >= pattern.Length)
        index = 0;

      // Compute the offset of the current dash from the curve start.
      double offset1 = offset0 + dashLength;
      if (offset1 > curveLength)
        offset1 = curveLength;

      // Solve the curve parameters at the current dash start and end.
      double t0, t1;
      curve.LengthParameter(offset0, out t0);
      curve.LengthParameter(offset1, out t1);

      Curve dash = curve.Trim(t0, t1);
      if (dash != null)
        dashes.Add(dash);

      // Get the current gap length.
      double gapLength = pattern[index++];
      if (index >= pattern.Length)
        index = 0;

      // Set the start of the next dash to be the end of the current
      // dash + the length of the adjacent gap.
      offset0 = offset1 + gapLength;

      // Abort when we've reached the end of the curve.
      if (offset0 >= curveLength)
        break;
    }

    return dashes;
  }

  private BoundingBox _clip;
  private readonly List<Curve> _curves = new List<Curve>();
  private readonly List<Color> _colors = new List<Color>();
  private readonly List<int> _widths = new List<int>();

  /// <summary>
  /// This method will be called once every solution, before any calls to RunScript.
  /// </summary>
  public override void BeforeRunScript()
  {
    _clip = BoundingBox.Empty;
    _curves.Clear();
    _colors.Clear();
    _widths.Clear();
  }

  /// <summary>
  /// Return a BoundingBox that contains all the geometry you are about to draw.
  /// </summary>
  public override BoundingBox ClippingBox
  {
    get { return _clip; }
  }
  /// <summary>
  /// Draw all wires and points in this method.
  /// </summary>
  public override void DrawViewportWires(IGH_PreviewArgs args)
  {
    for (int i = 0; i < _curves.Count; i++)
      args.Display.DrawCurve(_curves[i], _colors[i], _widths[i]);
  }
# ---------- end curve_display ----------
preview = CustomPreview(Geometry=conmesh, Material=ColourSwatch(SwatchColor=RGB(240, 240, 240)))

strip_indices_to_color = Panel("")
strip_indices_to_color_2 = Panel("")
# Paths tracing
# on strips
piece_id = Slider(0, range=0..39)
reload = Button()

# ---- group: U direction
# SDQ Mesh
# Initial SDQ Mesh
panel_2 = Panel("streamlines_U.txt")
# Streamlines
reload_2 = Button()
streamlines = GhPythonScript(recompute=reload_2, path=python, folder=folder, filename=panel_2)  # -> out, P1, P2, fis
# ---------- streamlines: Python ----------
__author__ = "ioanna"

import rhinoscriptsyntax as rs
import os
import re
import Rhino.Geometry as rg

file = os.path.join(path, folder, 'output', filename)

if (os.path.exists(file)):
    f_lines = open(file, "r").readlines()
    print("Loaded : " , file)
    P1 = []
    P2 = []
    fis = []
    
    num = 0 # number of segments
    
    for i, line in enumerate(f_lines):
        line.replace("\n", "") # remove newline character
        x = line.split(" ") # the last element is the break character
        if i==0:
            num = int(x[0])
            print("Found %d streamline segments" % num)
        else:
            x = [float(v) for v in x]
    
            P1.append(rg.Point3d(x[0], x[1], x[2]))
            P2.append(rg.Point3d(x[3], x[4], x[5]))
            fis.append(x[6])

else: 
    print("Could not find file : ", file)
# ---------- end streamlines ----------
number_slider = Slider(6, range=0..10)
number_slider_2 = Slider(0.75, range=0..1)
panel_3 = Panel(streamlines.out)
ln = Line(StartPoint=streamlines.P1, EndPoint=streamlines.P2)
multiplication = Multiplication(A=ColourSwatch(SwatchColor=RGB(0, 72, 255)), B=number_slider_2)
curve_display_2 = CSharpScript(Curve=ln, Width=number_slider, Colour=multiplication)  # inputs Curve: Curve, Width: Int32, Colour: Color, Dash: String; same code as curve_display

# ----
lng = ListLength(List=strip_indices_to_color)
lng_2 = ListLength(List=strip_indices_to_color_2)

# ----
# Load quad mesh partitions
button_2 = Button()
csfindfilenames = CsFindFilenames(recompute=button_2, starts_with="quad_mesh_s0", ends_with="obj", path=python, folder_name=folder)  # -> out, filenames, n; inputs recompute: Boolean
# ---------- csfindfilenames: Python ----------
import re
import os

    
def sorting_function(filename):
    number = int(re.search(r'id(\d+)', filename).group(1))
    return number
def get_files_with_name(startswith, endswith, DATA_PATH):
    """ Find all files with the specified start and end in the data path. """
    files = []
    if os.path.exists(DATA_PATH) and os.path.isdir(DATA_PATH):
        for file in os.listdir(DATA_PATH):
            if file.startswith(startswith) and file.endswith(endswith):
                files.append(file)
    print('Found %d files with the given criteria : ' % len(files) + str(files))
    return files
    
    

if starts_with and ends_with and path and folder_name:
    filenames = get_files_with_name(starts_with, ends_with, os.path.join(path, folder_name, 'output'))
    n = len(filenames)
    filenames = sorted(filenames, key=sorting_function)
else:
    print("Could not find any files in folder: ", os.path.join(path, folder_name, 'output'))
# ---------- end csfindfilenames ----------
load_unwelded_mesh_2 = GhPythonScript(recompute=button_2, path=python, folder=folder, filename=csfindfilenames.filenames)  # -> out, simplify(mesh)
# ---------- load_unwelded_mesh_2: Python ----------
__author__ = "ioanna"

import os
import Rhino.Geometry as rg
import rhinoscriptsyntax as rs

vertices = []
faces = []

if (path and folder and filename):
    file = os.path.join(path, folder, 'output', filename)
    
    if (os.path.exists(file)):
        for line in open(os.path.join(path, folder, 'output',filename), "r"):
            if line.startswith('#'): 
                continue
            values = line.split()
            if not values: 
                continue
                
            if values[0] == 'v':
                v = map(float, values[1:4])
                vertices.append(v)
            elif values[0] == 'f':
                face = []
                for v in values[1:]:
                    w = v.split('/')
                    if (int(w[0]) >= 0):
                        face.append(int(w[0]))
                faces.append(face)
                
        print('Vertices : ', len(vertices))    
        print('Faces : ', len(faces))
        
        new_faces = []
        for i, f in enumerate(faces):
            to_remove = []
            #print(f)
            for vf in f:
                if vf > len(vertices) or vf <= 1:
                    to_remove.append(vf)
            for vf in to_remove:
                f.remove(vf)
        
        
        mesh = rg.Mesh()
        
        for v in vertices:
            mesh.Vertices.Add(v[0], v[1], v[2]);
        for i, f in enumerate(faces):
            print(f)
            if (len(f) == 3):
                mesh.Faces.AddFace(f[0]-1, f[1]-1, f[2]-1);
            elif (len(f) == 4):
                mesh.Faces.AddFace(f[0]-1, f[1]-1, f[2]-1, f[3]-1);
            elif (len(f) == 5):
                mesh.Faces.AddFace(f[0]-1, f[1]-1, f[2]-1, f[3]-1);
                mesh.Faces.AddFace(f[0]-1, f[3]-1, f[4]-1)
            elif (len(f) == 6):
                mesh.Faces.AddFace(f[0]-1, f[1]-1, f[2]-1, f[3]-1);
                mesh.Faces.AddFace(f[0]-1, f[3]-1, f[4]-1)
                mesh.Faces.AddFace(f[0]-1, f[4]-1, f[5]-1)
    
    else:
        print("Could not load file : " , file)
else:
    print("Missing inputs")
# ---------- end load_unwelded_mesh_2 ----------
demesh_2 = DeconstructMesh(Mesh=load_unwelded_mesh_2.mesh)  # -> simplify(Vertices), simplify(Faces), Colours, Normals
facen = FaceNormals(Mesh=load_unwelded_mesh_2.mesh)  # -> simplify(Centers), Normals
lng_3 = ListLength(List=load_unwelded_mesh_2.mesh)
index = ItemIndex(List=load_unwelded_mesh_2.mesh, Item=load_unwelded_mesh_2.mesh)
medges_2 = MeshEdges(Mesh=load_unwelded_mesh_2.mesh)  # -> NakedEdges, InteriorEdges, NonManifoldEdges
input_mesh_2 = Mesh(input_mesh)
meshcp = MeshClosestPoint(Point=facen.Centers, Mesh=input_mesh_2)  # -> Point, Index, Parameter
gradient = Gradient(
    LowerLimit="0",
    UpperLimit=lng_3,
    Parameter=index,
    stops=[0: RGB(234, 38, 0), 0.25: RGB(234, 126, 0), 0.5: RGB(254, 244, 84), 0.75: RGB(173, 203, 249), 1: RGB(75, 107, 169)])
gradient_2 = Gradient(
    LowerLimit="0",
    UpperLimit=lng_3,
    Parameter=index,
    stops=[0: RGB(243, 57, 0), 0.0816: RGB(210, 0, 118), 0.194: RGB(219, 210, 195), 0.3: RGB(103, 0, 120), 0.4: RGB(39, 72, 161), 0.5: RGB(1, 192, 229), 0.6: RGB(18, 178, 90), 0.7: RGB(7, 61, 186), 0.8: RGB(220, 237, 32), 0.9: RGB(219, 142, 18)])
dist = Distance(PointA=facen.Centers, PointB=meshcp.Point)
crv = Curve(medges_2.NakedEdges)
smaller = SmallerThan(FirstNumber=dist, SecondNumber=Slider(0.001, range=0..0.01))  # -> SmallerThan, OrEqualTo
curve_display_3 = CSharpScript(Curve=crv, Width=Slider(1.25, range=0..10), Colour=ColourSwatch(SwatchColor=RGB(0, 0, 0)))  # inputs Curve: Curve, Width: Int32, Colour: Color, Dash: String; same code as curve_display
conmesh_2 = ConstructMesh(Vertices=demesh_2.Vertices, Faces=demesh_2.Faces, Colours=graft(gradient))  # -> flatten(Mesh)
dispatch = Dispatch(List=demesh_2.Faces, DispatchPattern=invert(smaller.SmallerThan))  # -> ListA, ListB
scale_2 = Scale(Geometry=conmesh_2, Center=Point(0, 0, 0), Factor=scale_factor_2)  # -> Geometry, Transform

repeat = RepeatData(Data=ColourSwatch(SwatchColor=RGB(255, 231, 92)), Length=lng)  # -> flatten(Data)
repeat_2 = RepeatData(Data=ColourSwatch(SwatchColor=RGB(153, 135, 255)), Length=lng_2)  # -> flatten(Data)

# ----
# Load cuts
panel_4 = Panel("current_cuts.txt")
# SDQ partitioning
button_3 = Button()
matrix6d = GhPythonScript(recompute=button_3, path=python, folder=folder, filename=panel_4)  # -> out, flatten(segments)
# ---------- matrix6d: Python ----------
__author__ = "ioanna"

import rhinoscriptsyntax as rs
import os
import re
import Rhino.Geometry as rg

file = os.path.join(path, folder, 'output', filename)
if (os.path.exists(file)):
    f_lines = open(file, "r").readlines()
    
    segments = []
    for line in f_lines:
        x = line.split(" ")[:-1] # the lat element is the break character
        x = [float(v) for v in x]
        if len(x) == 6:
            a = rg.Point3d(x[0], x[1], x[2])
            b = rg.Point3d(x[3], x[4], x[5])
            segments.append(rg.Line(a, b))
        else: 
            print("len(x) = ", len(x), " . We don't have such a vector!")
        
else:
    print("Could not load file : " , file)
# ---------- end matrix6d ----------
crv_2 = Curve(matrix6d.segments)
swatch = ColourSwatch(SwatchColor=RGB(0, 0, 0))
scale_3 = Scale(Geometry=crv_2, Center=Point(0, 0, 0), Factor=scale_factor_2)  # -> Geometry, Transform
curve_display_4 = CSharpScript(Curve=crv_2, Width=Slider(8, range=0..10), Colour=ColourSwatch(SwatchColor=RGB(219, 0, 0)))  # inputs Curve: Curve, Width: Int32, Colour: Color, Dash: String; same code as curve_display

size = Slider(0.05, range=0..0.1)

# ----
# Vector field
# and
# Parametrization
# Vector field
reload_3 = Button()
matrixxd = GhPythonScript(recompute=reload_3, path=python, folder=folder, filename="vf.txt")  # -> out, matrix_rows
# ---------- matrixxd: Python ----------
__author__ = "ioanna"

import rhinoscriptsyntax as rs
import os
import re
import Rhino.Geometry as rg

file = os.path.join(path, folder, 'output', filename)

if (os.path.exists(file)):
    f_lines = open(file, "r").readlines()
    
    matrix_rows = []
    for line in f_lines:
        x = line.split(" ")[:-1] # the lat element is the break character
        x = [float(v) for v in x]
        if len(x) == 2:
            matrix_rows.append(rg.Vector2d(*x))
        elif len(x) == 3:
            matrix_rows.append(rg.Vector3d(*x))
        else: 
            print("len(x) = ", len(x), " . We don't have such a vector!")
        
else: 
    print("Could not find file : ", file)
# ---------- end matrixxd ----------
python_2 = GhPythonScript(mesh=mesh)  # -> face_centers; inputs mesh: Mesh
# ---------- python_2: Python ----------
__author__ = "ioanna"

import rhinoscriptsyntax as rs
import Rhino.Geometry as rg

face_centers = rs.MeshFaceCenters(mesh)
# ---------- end python_2 ----------
multiplication_2 = Multiplication(A=matrixxd.matrix_rows, B=size)
neg = Negative(Value=multiplication_2)
move = Move(Geometry=python_2, Motion=multiplication_2)  # -> Geometry, Transform
move_2 = Move(Geometry=python_2, Motion=neg)  # -> Geometry, Transform
ln_2 = Line(StartPoint=python_2, EndPoint=move.Geometry)
ln_3 = Line(StartPoint=python_2, EndPoint=move_2.Geometry)

matrixxd_2 = GhPythonScript(recompute=reload_3, path=python, folder=folder, filename="vf_rotated.txt")  # -> out, matrix_rows
# ---------- matrixxd_2: Python ----------
__author__ = "ioanna"

import rhinoscriptsyntax as rs
import os
import re
import Rhino.Geometry as rg

file = os.path.join(path, folder, 'output', filename)

if (os.path.exists(file)):
    
    f_lines = open(file, "r").readlines()
    
    matrix_rows = []
    for line in f_lines:
        x = line.split(" ")[:-1] # the lat element is the break character
        x = [float(v) for v in x]
        if len(x) == 2:
            matrix_rows.append(rg.Vector2d(*x))
        elif len(x) == 3:
            matrix_rows.append(rg.Vector3d(*x))
        else: 
            print("len(x) = ", len(x), " . We don't have such a vector!")
        
else: 
    print("Could not find file : ", file)
# ---------- end matrixxd_2 ----------
python_3 = GhPythonScript(mesh=mesh)  # -> face_centers; inputs mesh: Mesh; same code as python_2
multiplication_3 = Multiplication(A=matrixxd_2.matrix_rows, B=size)
neg_2 = Negative(Value=multiplication_3)
move_3 = Move(Geometry=python_3, Motion=multiplication_3)  # -> Geometry, Transform
move_4 = Move(Geometry=python_3, Motion=neg_2)  # -> Geometry, Transform
ln_4 = Line(StartPoint=python_3, EndPoint=move_3.Geometry)
ln_5 = Line(StartPoint=python_3, EndPoint=move_4.Geometry)

number_slider_3 = Slider(3, range=0..1000)
merge = Merge(Data2=flatten(repeat), Data3=flatten(repeat_2))  # -> flatten(Result)

matrix6d_2 = GhPythonScript(recompute=Button(), path=python, folder=folder, filename="ribs_polylines.txt")  # -> out, flatten(segments)
# ---------- matrix6d_2: Python ----------
__author__ = "ioanna"

import rhinoscriptsyntax as rs
import os
import re
import Rhino.Geometry as rg

file = os.path.join(path, folder, 'output', filename)

if (os.path.exists(file)):
    print("Opening : " , file)
    f_lines = open(file, "r").readlines()
    
    segments = []
    for line in f_lines:
        x = line.split(" ")[:-1] # the lat element is the break character
        x = [float(v) for v in x]
        if len(x) == 6:
            a = rg.Point3d(x[0], x[1], x[2])
            b = rg.Point3d(x[3], x[4], x[5])
            segments.append(rg.Line(a, b))
        else: 
            print("len(x) = ", len(x), " . We don't have such a vector!")
        
else: 
    print("Could not find file : ", file)
# ---------- end matrix6d_2 ----------
panel_5 = Panel(matrix6d_2.out)
curve_display_5 = CSharpScript(Curve=matrix6d_2.segments, Width=Slider(6, range=0..10), Colour=ColourSwatch(SwatchColor=RGB(0, 0, 0)))  # inputs Curve: Curve, Width: Int32, Colour: Color, Dash: String; same code as curve_display

# ---- group: Load quad mesh
matrixxd_3 = GhPythonScript(recompute=reload, path=python, folder=folder, filename="V.txt")  # -> out, matrix_rows
# ---------- matrixxd_3: Python ----------
__author__ = "ioanna"

import rhinoscriptsyntax as rs
import os
import re
import Rhino.Geometry as rg


file = os.path.join(path, folder, 'output', filename)

if (os.path.exists(file)):
    
    f_lines = open(file, "r").readlines()
    
    matrix_rows = []
    for line in f_lines:
        x = line.split(" ")[:-1] # the lat element is the break character
        x = [float(v) for v in x]
        if len(x) == 2:
            matrix_rows.append(rg.Vector2d(*x))
        elif len(x) == 3:
            matrix_rows.append(rg.Vector3d(*x))
        else: 
            print("len(x) = ", len(x), " . We don't have such a vector!")
        
else: 
    print("Could not find file : ", file)
# ---------- end matrixxd_3 ----------
lng_4 = ListLength(List=matrixxd_3.matrix_rows)
faces = GhPythonScript(recompute=reload, path=python, folder=folder, nV=lng_4, filename="F.txt")  # -> out, matrix_rows; inputs nV: Int32
# ---------- faces: Python ----------
__author__ = "ioanna"

import rhinoscriptsyntax as rs
import os
import re
import Rhino.Geometry as rg
import Grasshopper
import System

"""
Function list_to_ghtree from compas library: https://github.com/compas-dev/compas
"""
def list_to_ghtree(items, none_and_holes=False, base_path=[0]):
    def process_one_item(items, tree, track):
        path = Grasshopper.Kernel.Data.GH_Path(System.Array[int](track))
        if len(items) == 0 and none_and_holes:
            tree.EnsurePath(path)
            return
        for i, item in enumerate(items):
            if hasattr(item, "__iter__"):
                track.append(i)
                process_one_item(item, tree, track)
                track.pop()
            else:
                if none_and_holes:
                    tree.Insert(item, path, i)
                elif item is not None:
                    tree.Add(item, path)

    tree = Grasshopper.DataTree[object]()
    if items is not None:
        process_one_item(items, tree, base_path[:])
    return tree

file = os.path.join(path, folder, 'output', filename)

if (os.path.exists(file)):
    f_lines = open(file, "r").readlines()
    print("Opened file : " + file)
    
    matrix_rows = []
    convert_to_tree = False
    for line in f_lines:
        x = line.split(" ")[:-1] # the lat element is the break character
        x = [int(v) for v in x]
        matrix_rows.append([data for data in x if data >= 0 and data < nV])
        #matrix_rows.append(x)
        convert_to_tree = True
            
    if convert_to_tree:
        matrix_rows = list_to_ghtree(matrix_rows)
else: 
    print("Could not open file : " + file)
# ---------- end faces ----------
fis = Integer(simplify(faces.matrix_rows))
vis = Point(matrixxd_3.matrix_rows)
python_4 = GhPythonScript(vis=vis, faces=fis)  # -> out, mesh; inputs vis: list of Point3d, faces: tree
# ---------- python_4: Python ----------
__author__ = "Ioanna"
__version__ = "2022.11.03"

import rhinoscriptsyntax as rs
import Rhino.Geometry as rg

"""
Function ghtree_to_list() from compas library: https://github.com/compas-dev/compas
"""
def ghtree_to_list(tree):
    def extend_at(path, index, simple_input, rest_list):
        target = path[index]
        if len(rest_list) <= target:
            rest_list.extend([None] * (target - len(rest_list) + 1))
        if index == path.Length - 1:
            rest_list[target] = list(simple_input)
        else:
            if rest_list[target] is None:
                rest_list[target] = []
            extend_at(path, index + 1, simple_input, rest_list[target])

    items = []
    for i in range(tree.BranchCount):
        path = tree.Path(i)
        extend_at(path, 0, tree.Branch(path), items)
    return items

if vis != [None] and faces != [None]:
    faces = ghtree_to_list(faces)
    mesh = rg.Mesh()
    
    for v in vis:
        mesh.Vertices.Add(v.X, v.Y, v.Z);
        
    
    for i, f in enumerate(faces):
        if (len(f) == 3):
            mesh.Faces.AddFace(f[0], f[1], f[2]);
        elif (len(f) == 4):
            mesh.Faces.AddFace(f[0], f[1], f[2], f[3]);
        elif (len(f) == 5):
            mesh.Faces.AddFace(f[0], f[1], f[2], f[3]);
            mesh.Faces.AddFace(f[0], f[3], f[4])
        elif (len(f) >= 6):
            mesh.Faces.AddFace(f[0], f[1], f[2], f[3]);
            mesh.Faces.AddFace(f[0], f[3], f[4])
            mesh.Faces.AddFace(f[0], f[4], f[5])
# ---------- end python_4 ----------
scale_4 = Scale(Geometry=vis, Center=Point(0, 0, 0), Factor=scale_factor_2)  # -> Geometry, Transform
item = ListItem(List=vis, Index=fis, Wrap=True)
demesh_3 = DeconstructMesh(Mesh=python_4.mesh)  # -> Vertices, Faces, Colours, Normals
conmesh_3 = ConstructMesh(Vertices=demesh_3.Vertices, Faces=demesh_3.Faces, Colours=ColourSwatch(SwatchColor=RGB(255, 255, 255)))
pline = PolyLine(Vertices=item, Closed=True)  # -> flatten(Polyline)
avr = Average(Input=item)  # -> flatten(ArithmeticMean)

# ---- group: Display Emaps
matrixxd_4 = GhPythonScript(recompute=reload, path=python, folder=folder, filename="Emap.txt")  # -> out, matrix_rows
# ---------- matrixxd_4: Python ----------
__author__ = "ioanna"

import rhinoscriptsyntax as rs
import os
import re
import Rhino.Geometry as rg

filename = os.path.join(path, folder, 'output', filename)

if (os.path.exists(filename)):

    f_lines = open(filename, "r").readlines()
    
    print("Opened file : " , os.path.join(path, folder, 'output', filename))
    
    matrix_rows = []
    for line in f_lines:
        x = line.split(" ")[:-1] # the lat element is the break character
        x = [float(v) for v in x]
        if len(x) == 2:
            matrix_rows.append(rg.Vector2d(*x))
        elif len(x) == 3:
            #if (x[2] != 1):
            matrix_rows.append(rg.Vector3d(*x))
        else: 
            print("len(x) = ", len(x), " . We don't have such a vector!")
else:
    print("Could not open file : ", filename)
# ---------- end matrixxd_4 ----------
lng_5 = ListLength(List=matrixxd_4.matrix_rows)
devec = DeconstructVector(Vector=matrixxd_4.matrix_rows)  # -> XComponent, YComponent, ZComponent
vertices = Point(vis)
panel_6 = Panel(matrixxd_4.out)
python_5 = GhPythonScript(e=devec.ZComponent)  # -> e; inputs e: list of Int32
# ---------- python_5: Python ----------
__author__ = "ioannam"
__version__ = "2022.09.28"

import rhinoscriptsyntax as rs

for i,val in enumerate(e):
    if val == -1:
        e[i] = 2
# ---------- end python_5 ----------
repeat_3 = RepeatData(Data=ColourSwatch(SwatchColor=RGB(0, 72, 255)), Length=lng_5)
repeat_4 = RepeatData(Data=ColourSwatch(SwatchColor=RGB(55, 219, 0)), Length=lng_5)
repeat_5 = RepeatData(Data=ColourSwatch(SwatchColor=RGB(255, 166, 0)), Length=lng_5)
number_slider_4 = Slider(6, range=0..10)
int = Integer(devec.XComponent)
int_2 = Integer(python_5)
int_3 = Integer(devec.YComponent)
python_6 = GhPythonScript(x=devec.ZComponent)  # -> pattern; inputs x: list of Int32
# ---------- python_6: Python ----------
__author__ = "ioannam"
__version__ = "2023.08.30"

import rhinoscriptsyntax as rs

pattern = []
for value in x:
    if value == 0:
        pattern.append(False)
    elif value == 1: 
        pattern.append(True)
    else:
        pattern.append(True)
# ---------- end python_6 ----------
item_2 = ListItem(List=vertices, Index=int_3, Wrap=True)
item_3 = ListItem(List=vertices, Index=int, Wrap=True)
p_n_c = PickNChoose(Pattern=int_2, Stream0=repeat_3, Stream1=repeat_4, Stream2=repeat_5)
ln_6 = Line(StartPoint=item_3, EndPoint=item_2)
dispatch_2 = Dispatch(List=ln_6, DispatchPattern=python_6)  # -> ListA, ListB

# ----
panel_7 = Panel(matrixxd.out)

# ---- group: Debugging path tracing
panel_8 = Panel("current_row_paths.txt")
paths = GhPythonScript(recompute=Button(), path=python, folder=folder, filename="all_temp_paths.txt")  # -> out, all_line_segments, paths
# ---------- paths: Python ----------
__author__ = "ioanna"

import rhinoscriptsyntax as rs
import os
import Rhino.Geometry as rg

all_line_segments = []
paths = []
#coords = []
vs = []
normals = []

file = os.path.join(path, folder, 'output', filename)

if (os.path.exists(file)):
    f_lines = open(file, "r").readlines()
    print(os.path.join(path, folder, 'output', filename))
    for line in f_lines:    
        x = line.split(" , ")
        print(x)
        
        if len(x) > 1 and (x[0] == 's'):
            # add segment
            p1 = rg.Point3d(float(x[1]), float(x[2]), float(x[3]))
            p2 = rg.Point3d(float(x[4]), float(x[5]), float(x[6]))
            n = rg.Vector3d(float(x[7]), float(x[8]), float(x[9]))
            all_line_segments.append(rg.Line(p1, p2))
            vs.extend([p1, p2])
            normals.append(n)
    
        elif x[0] == 'end' :
            paths.append(rs.AddPolyline(vs))
            vs = []
    
        else :
            print('Unknown line: ' + str(x))
else:
    print("Could not load file : " , file)
# ---------- end paths ----------
panel_9 = Panel(paths.out)
crv_3 = Curve(paths.paths)

# ---- group: Paths on pieces
python_7 = GhPythonScript(name="paths_collection", idx=piece_id, ext=".txt")  # -> a; inputs idx: Int32
# ---------- python_7: Python ----------
a = name + '_id' + str(idx) + ext
# ---------- end python_7 ----------
paths_2 = GhPythonScript(recompute=Button(), path=python, folder=folder, filename=python_7)  # -> out, all_line_segments, normals, paths, are_closed, parent_fis
# ---------- paths_2: Python ----------
__author__ = "ioanna"

import rhinoscriptsyntax as rs
import os
import Rhino.Geometry as rg

all_line_segments = []
paths = []
#coords = []
vs = []
normals = []
are_closed = []
parent_fis = []

file = os.path.join(path, folder, 'output', filename)

file = os.path.join(path, folder, 'output', filename)
if (os.path.exists(file)):
    f_lines = open(file, "r").readlines()
    print(os.path.join(path, folder, 'output', filename))
    for line in f_lines:    
        x = line.split(" , ")
        
        if len(x) > 1 and x[0] == 'is_closed':
            are_closed.append(x[1])
        
        elif len(x) > 1 and (x[0] == 's'):
            # add segment
            p1 = rg.Point3d(float(x[1]), float(x[2]), float(x[3]))
            p2 = rg.Point3d(float(x[4]), float(x[5]), float(x[6]))
            n = rg.Vector3d(float(x[7]), float(x[8]), float(x[9]))
            
            all_line_segments.append(rg.Line(p1, p2))
            vs.extend([p1, p2])
            normals.append(n)
            parent_fis.append(float(x[10]))
    
        elif x[0] == 'end' :
            paths.append(rs.AddPolyline(vs))
            vs = []
    
        else :
            print('Unknown line: ' + str(x))

else:
    print("Could not load file : " , file)
# ---------- end paths_2 ----------
line_segments = Curve(paths_2.all_line_segments)
panel_10 = Panel(paths_2.out)
paths_3 = Curve(simplify(paths_2.paths))
dispatch_3 = Dispatch(List=paths_3, DispatchPattern=paths_2.are_closed)  # -> ListA, ListB
closed_paths = Curve(dispatch_3.ListA)
open_paths = Curve(dispatch_3.ListB)

# ---- group: V direction
streamlines_2 = GhPythonScript(recompute=reload_2, path=python, folder=folder, filename="streamlines_V.txt")  # -> out, P1, P2, fis; same code as streamlines
panel_11 = Panel(streamlines_2.out)
ln_7 = Line(StartPoint=streamlines_2.P1, EndPoint=streamlines_2.P2)
multiplication_4 = Multiplication(A=ColourSwatch(SwatchColor=RGB(55, 219, 0)), B=number_slider_2)
curve_display_6 = CSharpScript(Curve=ln_7, Width=number_slider, Colour=multiplication_4)  # inputs Curve: Curve, Width: Int32, Colour: Color, Dash: String; same code as curve_display

# ----
relay = Relay([ln_2, ln_3])
relay_2 = Relay([ln_4, ln_5])

# ---- group: Lines visualization
number_slider_5 = Slider(0.8, range=0..1)
number_slider_6 = Slider(6, range=0..10)
multiplication_5 = Multiplication(A=number_slider_5, B=ColourSwatch(SwatchColor=RGB(55, 219, 0)))
multiplication_6 = Multiplication(A=ColourSwatch(SwatchColor=RGB(0, 72, 255)), B=number_slider_5)
curve_display_7 = CSharpScript(Curve=relay, Width=number_slider_6, Colour=multiplication_6)  # inputs Curve: Curve, Width: Int32, Colour: Color, Dash: String; same code as curve_display
curve_display_8 = CSharpScript(Curve=relay_2, Width=number_slider_6, Colour=multiplication_5)  # inputs Curve: Curve, Width: Int32, Colour: Color, Dash: String; same code as curve_display

# ----
number_slider_7 = Slider(0.125, range=0..1)

face_cens = Point(avr)
vertices_2 = Point(vis)

# ---- group: Guiding directions (per piece)
python_8 = GhPythonScript(name="guiding_dirs", idx=piece_id, ext=".txt")  # -> a; inputs idx: Int32; same code as python_7
matrixxd_5 = GhPythonScript(path=python, folder=folder, filename=python_8)  # -> out, matrix_rows
# ---------- matrixxd_5: Python ----------
__author__ = "ioanna"

import rhinoscriptsyntax as rs
import os
import re
import Rhino.Geometry as rg

file = os.path.join(path, folder, 'output', filename)
if (os.path.exists(file)):
    f_lines = open(file, "r").readlines()
    
    print()
    
    matrix_rows = []
    for line in f_lines:
        x = line.split(" ")[:-1] # the lat element is the break character
        x = [float(v) for v in x]
        if len(x) == 2:
            matrix_rows.append(rg.Vector2d(*x))
        elif len(x) == 3:
            matrix_rows.append(rg.Vector3d(*x))
        else: 
            print("len(x) = ", len(x), " . We don't have such a vector!")
else:
    print("Could not load file : " , file)
# ---------- end matrixxd_5 ----------
face_cens_2 = Point(face_cens)
vdis = VectorDisplay(Anchor=face_cens_2, Vector=expr("x*0.03", matrixxd_5.matrix_rows))

# ---- group: display mesh faces
preview_2 = CustomPreview(Geometry=pline, Material=ColourSwatch(SwatchColor=RGBA(159, 171, 227, 134)))
preview_3 = CustomPreview(
    Geometry=conmesh_3,
    Material={diffuse=RGB(221, 160, 221), emission=RGB(66, 48, 66), shine=0.5, specular=RGB(255, 255, 255), transparency=0})

# ----
green_and_boundary = Curve(dispatch_2.ListA)
curve_display_9 = CSharpScript(Curve=ln_6, Width=number_slider_4, Colour=p_n_c)  # inputs Curve: Curve, Width: Int32, Colour: Color, Dash: String; same code as curve_display
only_blue = Curve(dispatch_2.ListB)

medges_3 = MeshEdges(Mesh=conmesh_2)  # -> NakedEdges, InteriorEdges, NonManifoldEdges
area = Area(Geometry=scale_2.Geometry)  # -> Area, Centroid
index_2 = ItemIndex(List=scale_2.Geometry, Item=scale_2.Geometry)
curve_display_10 = CSharpScript(Curve=paths_3, Width=Slider(1.41, range=0..10), Colour=ColourSwatch(SwatchColor=RGB(0, 0, 0)))  # inputs Curve: Curve, Width: Int32, Colour: Color, Dash: String; same code as curve_display
item_4 = ListItem(List=scale_2.Geometry, Index=Slider(39, range=0..39), Wrap=True)

# ----
# Seamless parametrization UV coordinates
reload_4 = Button()
matrixxd_6 = GhPythonScript(recompute=reload_4, path=python, folder=folder, filename="UVcoords.txt")  # -> out, matrix_rows; same code as matrixxd_2
load_unwelded_mesh_3 = GhPythonScript(recompute=reload_4, path=python, folder=folder, filename="mesh_cut.obj")  # -> out, mesh
# ---------- load_unwelded_mesh_3: Python ----------
__author__ = "ioanna"

import os
import Rhino.Geometry as rg
import rhinoscriptsyntax as rs


vertices = []
faces = []

file = os.path.join(path, folder, 'output', filename)

if (os.path.exists(file)):
    
    for line in open(file, "r"):
        if line.startswith('#'): 
            continue
        values = line.split()
        if not values: 
            continue
            
        if values[0] == 'v':
            v = map(float, values[1:4])
            vertices.append(v)
        elif values[0] == 'f':
            face = []
            for v in values[1:]:
                w = v.split('/')
                face.append(int(w[0]))
            faces.append(face)
            
    print('Vertices : ', len(vertices))    
    print('Faces : ', len(faces))
    
    
    mesh = rg.Mesh()
    
    for v in vertices:
        mesh.Vertices.Add(v[0], v[1], v[2]);
    for i, f in enumerate(faces):
        mesh.Faces.AddFace(f[0]-1, f[1]-1, f[2]-1);
    
else: 
    print("Could not find file : ", file)
# ---------- end load_unwelded_mesh_3 ----------
devec_2 = DeconstructVector(Vector=matrixxd_6.matrix_rows)  # -> XComponent, YComponent, ZComponent
panel_12 = Panel(load_unwelded_mesh_3.out)
mesh_2 = Mesh(load_unwelded_mesh_3.mesh)
bnd = Bounds(Numbers=devec_2.YComponent)
bnd_2 = Bounds(Numbers=devec_2.XComponent)
input_mesh_3 = Mesh(mesh_2)
dedomain = DeconstructDomain(Domain=bnd)  # -> Start, End
dedomain_2 = DeconstructDomain(Domain=bnd_2)  # -> Start, End
gradient_3 = Gradient(
    LowerLimit=dedomain.Start,
    UpperLimit=dedomain.End,
    Parameter=devec_2.YComponent,
    stops=[0: RGB(234, 38, 0), 0.25: RGB(234, 126, 0), 0.5: RGB(254, 244, 84), 0.75: RGB(173, 203, 249), 1: RGB(75, 107, 169)])
demesh_4 = DeconstructMesh(Mesh=input_mesh_3)  # -> Vertices, Faces, Colours, Normals
gradient_4 = Gradient(
    LowerLimit=dedomain_2.Start,
    UpperLimit=dedomain_2.End,
    Parameter=devec_2.XComponent,
    stops=[0: RGB(234, 38, 0), 0.25: RGB(234, 126, 0), 0.5: RGB(254, 244, 84), 0.75: RGB(173, 203, 249), 1: RGB(75, 107, 169)])

tag = TextTag3D(Location=area.Centroid, Text=index_2, Size=Slider(30, range=0..100), Justification=7)

# ---- group: Principal directions of each piece
button_4 = Button()
matrixxd_7 = GhPythonScript(recompute=button_4, path=python, folder=folder, filename="directions.txt")  # -> out, matrix_rows
# ---------- matrixxd_7: Python ----------
__author__ = "ioanna"

import rhinoscriptsyntax as rs
import os
import re
import Rhino.Geometry as rg

file = os.path.join(path, folder, 'output', filename)

if (os.path.exists(file)):
    f_lines = open(file, "r").readlines()
    print("Loaded : " , file)
    matrix_rows = []
    for line in f_lines:
        x = line.split(" ")[:-1] # the lat element is the break character
        x = [float(v) for v in x]
        if len(x) == 2:
            matrix_rows.append(rg.Vector2d(*x))
        elif len(x) == 3:
            matrix_rows.append(rg.Vector3d(*x))
        else: 
            print("len(x) = ", len(x), " . We don't have such a vector!")
else: 
    print("Could not load file : " , file)
# ---------- end matrixxd_7 ----------
vectorxd = GhPythonScript(recompute=button_4, path=python, folder=folder, filename="extents.txt")  # -> out, vectorXd
# ---------- vectorxd: Python ----------
__author__ = "ioanna"

import rhinoscriptsyntax as rs
import os
import re
import Rhino

file = os.path.join(path, folder, 'output', filename)
if (os.path.exists(file)):
    f = open(file, "r").read()
    x = f.split(" , ")[:-1] # the last value is invalid
    vectorXd = [float(s) for s in x]
else: 
    print("Could not load file : " , file)
# ---------- end vectorxd ----------
avr_2 = Average(Input=vis)
multiplication_7 = Multiplication(A=matrixxd_7.matrix_rows, B=vectorxd.vectorXd)
panel_13 = Panel(vectorxd.vectorXd)
item_5 = ListItem(List=multiplication_7, Index=Slider(0, range=0..2), Wrap=True)
vdis_2 = VectorDisplay(Anchor=avr_2, Vector=item_5)

# ----
reload_5 = Button()
vectorxd_2 = GhPythonScript(recompute=reload_5, path=python, folder=folder, filename="Fmap.txt")  # -> out, vectorXd
# ---------- vectorxd_2: Python ----------
__author__ = "ioanna"

import rhinoscriptsyntax as rs
import os
import re
import Rhino

file = os.path.join(path, folder, 'output', filename)

if (os.path.exists(file)):
    f = open(file, "r").read()
    x = f.split(" , ")[:-1] # the last value is invalid
    vectorXd = [float(s) for s in x]
else:
    print("Could not find file : ", file)
# ---------- end vectorxd_2 ----------
face_cens_3 = Point(face_cens)

panel_14 = Panel(vectorxd_2.out)
number_slider_8 = Slider(5, range=0..10)
bnd_3 = Bounds(Numbers=vectorxd_2.vectorXd)
dedomain_3 = DeconstructDomain(Domain=bnd_3)  # -> Start, End
number_slider_9 = Slider(0.004, range=0..0.1)
number_slider_10 = Slider(0.01, range=0..0.1)
gradient_5 = Gradient(
    LowerLimit=dedomain_3.Start,
    UpperLimit=dedomain_3.End,
    Parameter=vectorxd_2.vectorXd,
    stops=[0: RGB(0, 0, 0), 0.25: RGB(234, 126, 0), 0.5: RGB(254, 244, 84), 0.75: RGB(173, 203, 249), 1: RGB(75, 107, 169)])
tag_2 = TextTag3D(Location=face_cens_3, Text=vectorxd_2.vectorXd, Size=expr("x*2", number_slider_8), Justification=7)
cloud = CloudDisplay(Points=face_cens_3, Colours=gradient_5, Size=number_slider_8, SpriteType=1)

# ---- group: V visualization
conmesh_4 = ConstructMesh(Vertices=demesh_4.Vertices, Faces=demesh_4.Faces, Colours=gradient_3)

# ---- group: U visualization
conmesh_5 = ConstructMesh(Vertices=demesh_4.Vertices, Faces=demesh_4.Faces, Colours=gradient_4)

# ---- group: Strips
face_vertices = Integer(simplify(faces.matrix_rows))
vectorxd_3 = GhPythonScript(recompute=reload, path=python, folder=folder, filename="strips_directions.txt")  # -> out, vectorXd
# ---------- vectorxd_3: Python ----------
__author__ = "ioanna"

import rhinoscriptsyntax as rs
import os
import re
import Rhino

file = os.path.join(path, folder, 'output', filename)

if (os.path.exists(file)):
    f = open(file, "r").read()
    x = f.split(" , ")[:-1] # the last value is invalid
    vectorXd = [float(s) for s in x]
    #print("Loaded file : ", file)
    print("File contains : %d entries" % len(vectorXd))
else:
    print("Could not load file : " , file)
# ---------- end vectorxd_3 ----------
all_strips = GhPythonScript(recompute=reload, path=python, folder=folder, filename="strips.txt", row_i=graft(number_slider_3))  # -> out, row; inputs row_i: Int32
# ---------- all_strips: Python ----------
__author__ = "ioanna"

import rhinoscriptsyntax as rs
import os
import re
import Rhino.Geometry as rg

file = os.path.join(path, folder, 'output', filename)
try:
    f_lines = open(os.path.join(path, folder, 'output', filename), "r").readlines()
    
    print("Number of rows : %d " % len(f_lines))
    
    row = f_lines[row_i].split(" ")[:-1] # the lat element is the break character
    row = [int(v) for v in row]
except:
    print("Could not load file : " , file)
# ---------- end all_strips ----------
demesh_5 = DeconstructMesh(Mesh=python_4.mesh)  # -> Vertices, Faces, Colours, Normals
face_cens_4 = Point(face_cens)
item_6 = ListItem(List=face_vertices, Index=0, Wrap=True)  # -> Item, Item1, Item2, Item3
item_7 = ListItem(List=vectorxd_3.vectorXd, Index=number_slider_3, Wrap=True)
dispatch_4 = Dispatch(List=face_cens_4, DispatchPattern=all_strips.row)  # -> ListA, ListB
panel_15 = Panel(vectorxd_3.out)
panel_16 = Panel(all_strips.out)
item_8 = ListItem(List=demesh_5.Vertices, Index=item_6.Item, Wrap=True)
item_9 = ListItem(List=demesh_5.Vertices, Index=item_6.Item1, Wrap=True)
item_10 = ListItem(List=demesh_5.Vertices, Index=item_6.Item2, Wrap=True)
item_11 = ListItem(List=demesh_5.Vertices, Index=item_6.Item3, Wrap=True)
direction = Panel(item_7)
pt = Point(dispatch_4.ListA)
srf4pt = _4PointSurface(CornerA=item_8, CornerB=item_9, CornerC=item_10, CornerD=item_11)
faces_2 = Geometry(flatten(srf4pt))
item_12 = ListItem(
    List=[ColourSwatch(SwatchColor=RGB(54, 151, 255)), ColourSwatch(SwatchColor=RGB(133, 227, 107))],
    Index=direction,
    Wrap=True)

# ----
smesh = SimpleMesh(Brep=faces_2)

# ---- group: Strips (continued)
dispatch_5 = Dispatch(List=smesh, DispatchPattern=all_strips.row)  # -> simplify(ListA), ListB

# ----
mjoin = MeshJoin(Meshes=dispatch_5.ListA)  # -> flatten(Mesh)

# ---- group: Strips (continued)
preview_4 = CustomPreview(Geometry=mjoin, Material=graft(item_12))
